# Dynamo custom node Add_Regions_to_corridor.dyf "Add_Regions_to_Corridor" (Dynamo 2.19.4.6671)
# category: TBW.addregions.corridor
# Add Regions to Corridor
# packages: Civil3DToolkit 1.1.32

corridor = Input(corridor: Autodesk.Civil.DynamoNodes.Corridor)
baselines = Autodesk.Civil.DynamoNodes.Corridor.Baselines(corridor=corridor)
name = Input(name: string)
assemblyName = Input(assemblyName: string)
Stations = Input(Stations: var)
SliderValue = Input(SliderValue: var)
code_block = CodeBlock { 0.5; }
div = SliderValue / code_block
add = Stations + div
StationlessFirst = Input(StationlessFirst: var)
sub = StationlessFirst - div
code_block_2 = CodeBlock { 5; }
boolean = BoolSelector(true)
addRegion = Autodesk.Civil.DynamoNodes.CorridorExtensions.CorridorExtensions.AddRegion(baseline=baselines, name=name@@L4, assemblyName=assemblyName@L4, start=add@L4, end=sub@L4, curveFreq=code_block_2, tangentFreq=code_block_2, rebuild=boolean)
BaselineRegion = Output(addRegion)
