# Dynamo graph CP_CIV_FAM_TBW_Create_Corridor_from_XLSX_2024-07-01_0.8.dyn (Dynamo 2.19.4.6671)
# packages: Civil3DToolkit 1.1.32, Arkance Systems 7.3.0, Camber 4.2.6

# note: DYNAMO DEFAULTS
# note: ADDITIONAL JACOBS CATEGORIES
# note: |
# |
# |
# |
# |
# |
# |
# |
# |
# |
# |
# |
# |
# |
# |
# |
# |
# |
# |
# |
# |
# |
# |
# |
# |
# |
# |
# note: ADDITIONAL PERSONAL CATEGORIES
# note: CP_CIV_FAM_TBW_Create_Corridor_from_XLSX_2024-07-01_0.8.dyn

# group: <PROJECT NO.> <PROJECT NAME>
# note: Created By: FirstName LastName
# Email:  your.email@jacobs.com
# Phone: XXX-XXX-XXXX (optional)
# VERSION HISTORY
# YYYY-MM-DD v0.x: Pre-Release Builds
# YYYY-MM-DD v1.0: Initial Release Build
# YYYY-MM-DD v1.x: Minor Release Build (bug fix, revisions to groups, documentation, etc..)
# YYYY-MM-DD v2.0: Major Release Build (re-design due to depreciated nodes, addition of new features, identification of more optimized node layouts)
# DYNAMO VERSION: <Dynamo 2.6.0>
# PACKAGES:
# <PACKAGES>
# NOTES:
# <NOTES>
# JACOBS DYNAMO GRAPHIC STANDARD - 2022
# ADAPTED BY: MARINA VILLANUEVA
# SOURCES: Vladimir Ondejcik, WHITE ARKITEKTER AB - 2016 & JACOBS US GRAPHIC STANDARD - 2017

# group: DESIGNER'S GUIDELINES
# note: DESIGNER'S GUIDELINES
# 1. DIVIDE THE DYNAMO DEFINITION INTO THE USER INTERFACE AND THE BACK-END
# 2. BUILD THE DEFINITION WITH SMALL BLOCKS
# 3. BLOCKS SHOULD ALWAYS HAVE INPUT/OUTPUT
# 4. RENAME INPUT/OUTPUT CONTAINERS TO DATA THEY CARRY
# 5. COLOR-CODE BLOCKS ACCORDING TO THE TEMPLATE

# group: Input
# note: INPUT
# note: USE:
# FOR THE INCOMMING REFFERENCES
# (FILE PATHS, GEOMETRIES ...                     )

# group: CONTROL
# note: CONTROL
# note: USE:
# FOR THE USER INPUT (SUCH AS SLIDERS,
#  NUMBERS, ....)

# group: DESIGN
# note: DESIGN
# note: USE:
# FOR THE BACK-END FUNCTIONALITY

# group: FOR INFORMATION ONLY - REMOVE
# note: Jacobs Dynamo File Naming Convention:
# [MK]_[DIS]_[FAM/PRJ]_(*Project Name)_(Author)_[Title]_[Date]_[Version].dyn
# [MK] = 2 character group name for your market or ZZ for a market agnostic definition. (CP - Cities & Places; AF - Advanced Facilities; HE - Health; TR - Transportation; WA - Water; EP- Energy & Power; EN - Environmental)
# [DIS] = 3 character group name for your discipline or GEN for a generic definition.
# [FAM/PRJ] = Is the definition to be executed on a family or project?
# (*Project Name) = Optional to include the project name if definition was created for a specific project.
# (*Author's Initials) = Take credit for this great graph.
# [Title] = WhatTheScriptDoes
# [Version] = Version to match vX.X
# Examples:
# ZZ_GEN_PRJ_AddNewLevelAboveExistingByCurrentOffset_v1.0
# CP_ARC_PRJ_L100XXXX_SheetReferenceTool_v1.2

# group: TO REVIT / C3D
# note: TO CIVIL
# note: USE:
# FOR BLOCKS THAT EXPORT THE GEOMETRY AND PARAMETERS TO REVIT

# group: MONITOR
# note: MONITOR
# note: USE:
# FOR IMPORTANT WATCH NODES

# group: ANNOTATION
# note: ANNOTATION
# note: USE:
# FOR COMMENTS

# group: WIP
# note: WIP
# note: USE:
# FOR "WORK IN PROGRESS"

# group: Actions
# note: INPUT
# note: USE:
# (NODES THAT PROCESS OR REFINE DATA, MATH OR OTHER INPUTS)

# group: Outputs
# note: OUTPUT
# note: USE:
# (DATA GOING BACK TO OUT CIVIL 3D, EXCEL OR OTHER)

# group: Review
# note: REVIEW
# note: USE:
# FOR IMPORTANT WATCH NODES

# group: SORT
# note: SORT
# note: USE:
# (SORTING THROUGH, FILTERING OR PROCCESSING DATA OR INFOMATION)

# group: NEEDS REFINEMENT
# note: NEEDS REFINEMENT
# note: USE:
# (NEEDS REFINEMENT; THE LAST THING YOUR WERE WORKING ON OR PERHAPS UNRESOLVED ISSUES, COULD ALSO MEAN I THINK THE ISSUE IS IN THIS GROUP OF NODES)

# group: Inputs
code_block = CodeBlock { "KK-RVR-Realignment"; }
current = Autodesk.AutoCAD.DynamoNodes.Document.Current()

# group: Test for Surface
surfaceByName = Autodesk.Civil.DynamoNodes.Selection.SurfaceByName(name=code_block, document=current)
code_block_2 = CodeBlock { "True"; "False"; }
scopeIf = ScopedIf(test=surfaceByName, true=code_block_2.out0, false=code_block_2.out1)
contains = String.Contains(string=scopeIf, searchFor=code_block)

# group: Filter by Boolean Mask
filterByBoolMask = List.FilterByBoolMask(list=scopeIf, mask=contains)
list_create = List.Create(item0=filterByBoolMask.in, item1=code_block)
list_create_2 = List.Create(item0=filterByBoolMask.out, item1=code_block)

code_block_3 = CodeBlock { 1; }
dropItems = List.DropItems(list=list_create, amount=code_block_3)
watch = Watch(dropItems)
corridorByName = Autodesk.Civil.DynamoNodes.Selection.CorridorByName(name=watch, document=current)
rebuild = Autodesk.Civil.DynamoNodes.Corridor.Rebuild(corridor=corridorByName)
surfaces = Autodesk.Civil.DynamoNodes.Corridor.Surfaces(corridor=rebuild)
rebuild_2 = Autodesk.Civil.DynamoNodes.Surface.Rebuild(surface=surfaces)
string = StringInput("Proposed Stream CL")
current_2 = Autodesk.AutoCAD.DynamoNodes.Document.Current()
alignmentByName = Autodesk.Civil.DynamoNodes.Selection.AlignmentByName(name=string, document=current_2)
bench_profile_name_string = StringInput("Revised Bankfull Bench")
file_path = Filename(".\KK River Revised 30% Channel Design Calcs.xlsx")
file_from_path = FileObject(path=file_path)
sheet_name = StringInput("Stream Profile")

# group: Extracting and sorting Content from XLSX
boolean = BoolSelector(true)
importExcel = Data.ImportExcel(file=file_from_path, sheetName=sheet_name, showExcel=boolean)
code_block_4 = CodeBlock { 1; }
dropItems_2 = List.DropItems(list=importExcel, amount=code_block_4)
code_block_5 = CodeBlock { -53; }
dropItems_3 = List.DropItems(list=dropItems_2, amount=code_block_5)
transpose = List.Transpose(lists=dropItems_3)
code_block_6 = CodeBlock { 5; 7; }
dropItems_4 = List.DropItems(list=transpose, amount=code_block_6.out0)
code_block_7 = CodeBlock { 0; 1; }
station_list_slice = List.Slice(list=dropItems_4, start=code_block_7.out0, end=code_block_7.out1)
code_block_8 = CodeBlock { 10; 11; }
bench_elevations_list_slice = List.Slice(list=transpose, start=code_block_8.out0, end=code_block_8.out1)
dropItems_5 = List.DropItems(list=transpose, amount=code_block_6.out1)
code_block_9 = CodeBlock { 0; 1; }
thalweg_elevations_list_slice = List.Slice(list=dropItems_5, start=code_block_9.out0, end=code_block_9.out1)
code_block_10 = CodeBlock { 0; 1; }
region_names_list_slice = List.Slice(list=transpose, start=code_block_10.out0, end=code_block_10.out1)
code_block_11 = CodeBlock { 1; 2; }
typical_sections_list_slice = List.Slice(list=transpose, start=code_block_11.out0, end=code_block_11.out1)
boolean_2 = BoolSelector(false)
typical_sections_list_clean = List.Clean(list=typical_sections_list_slice, preserveIndices=boolean_2)

# group: Create Bankfull Bench Profile
stationElevation = Civil3D.Geometry.StationElevation.StationElevation(station=station_list_slice, elevation=bench_elevations_list_slice)
createLayoutProfile = Civil3D.Geometry.Profile.CreateLayoutProfile(alignment=alignmentByName, profilename=bench_profile_name_string, vertices=stationElevation)

code_block_12 = CodeBlock { 1; }
dropItems_6 = List.DropItems(list=list_create_2, amount=code_block_12)
watch_2 = Watch(dropItems_6)
profile_name_string = StringInput("Revised Stream Profile")

# group: Create Thalweg Profile
stationElevation_2 = Civil3D.Geometry.StationElevation.StationElevation(station=station_list_slice, elevation=thalweg_elevations_list_slice)
createLayoutProfile_2 = Civil3D.Geometry.Profile.CreateLayoutProfile(alignment=alignmentByName, profilename=profile_name_string, vertices=stationElevation_2)

byAlignmentProfile = Autodesk.Civil.DynamoNodes.CorridorExtensions.CorridorExtensions.ByAlignmentProfile(name=watch_2, alignment=alignmentByName, profile=createLayoutProfile_2)

# group: Set Region Gap Size
integer_slider = IntegerSlider(2, range=0..30 step 1)

# group: Filter Out first station value
code_block_13 = CodeBlock { 1; }
dropItems_7 = List.DropItems(list=station_list_slice@L2, amount=code_block_13)

# group: Add Regions to corridor
baselines = Autodesk.Civil.DynamoNodes.Corridor.Baselines(corridor=byAlignmentProfile)
code_block_14 = CodeBlock { 0.5; }
div = integer_slider / code_block_14
add = station_list_slice + div
sub = dropItems_7 - div
code_block_15 = CodeBlock { 5; }
boolean_3 = BoolSelector(true)
addRegion = Autodesk.Civil.DynamoNodes.CorridorExtensions.CorridorExtensions.AddRegion(baseline=baselines, name=region_names_list_slice@@L4, assemblyName=typical_sections_list_clean@L4, start=add@L4, end=sub@L4, curveFreq=code_block_15, tangentFreq=code_block_15, rebuild=boolean_3)

# group: Gate
gated_passthrough_node = CodeBlock(passthrough1=byAlignmentProfile, waitfor=addRegion) { [passthrough1,waitfor][0]; }

# group: Create Surface from Corridor
code_block_16 = CodeBlock { "Top"; "P2"; }
surface_styles = SurfaceStyleDropDown("MMSD-CONTOURS 1' and 5'")
boolean_4 = BoolSelector(true)
addCorridorSurface = Camber.Civil.CivilObjects.Corridor.AddCorridorSurface(corridor=gated_passthrough_node, surfaceName=watch_2, linkCodes=code_block_16.out0, featureLineCodes=code_block_16.out1, style=surface_styles, addLinkCodesAsBreaklines=boolean_4, addExtentsAsBoundary=boolean_4)
