# Dynamo graph CP_CIV_FAM_TBW_Pull_Sections_from_XLSX_2024-07-01_0.5.dyn (Dynamo 2.19.4.6671)
# packages: Civil3DToolkit 1.1.32, Camber 4.2.6

# note: DYNAMO DEFAULTS
# note: ADDITIONAL PERSONAL CATEGORIES
# note: |
# |
# |
# |
# |
# |
# |
# |
# |
# |
# |
# |
# |
# |
# |
# |
# |
# |
# |
# |
# |
# |
# |
# |
# |
# |
# |
# note: ADDITIONAL JACOBS CATEGORIES
# note: CP_CIV_FAM_TBW_Pull_Sections_from_XLSX_2024-07-01_0.5.dyn

# group: DESIGNER'S GUIDELINES
# note: DESIGNER'S GUIDELINES
# 1. DIVIDE THE DYNAMO DEFINITION INTO THE USER INTERFACE AND THE BACK-END
# 2. BUILD THE DEFINITION WITH SMALL BLOCKS
# 3. BLOCKS SHOULD ALWAYS HAVE INPUT/OUTPUT
# 4. RENAME INPUT/OUTPUT CONTAINERS TO DATA THEY CARRY
# 5. COLOR-CODE BLOCKS ACCORDING TO THE TEMPLATE

# group: <PROJECT NO.> <PROJECT NAME>
# note: Created By: FirstName LastName
# Email:  your.email@jacobs.com
# Phone: XXX-XXX-XXXX (optional)
# VERSION HISTORY
# YYYY-MM-DD v0.x: Pre-Release Builds
# YYYY-MM-DD v1.0: Initial Release Build
# YYYY-MM-DD v1.x: Minor Release Build (bug fix, revisions to groups, documentation, etc..)
# YYYY-MM-DD v2.0: Major Release Build (re-design due to depreciated nodes, addition of new features, identification of more optimized node layouts)
# DYNAMO VERSION: <Dynamo 2.6.0>
# PACKAGES:
# <PACKAGES>
# NOTES:
# <NOTES>
# JACOBS DYNAMO GRAPHIC STANDARD - 2022
# ADAPTED BY: MARINA VILLANUEVA
# SOURCES: Vladimir Ondejcik, WHITE ARKITEKTER AB - 2016 & JACOBS US GRAPHIC STANDARD - 2017

# group: Actions
# note: INPUT
# note: USE:
# (NODES THAT PROCESS OR REFINE DATA, MATH OR OTHER INPUTS)

# group: Input
# note: INPUT
# note: USE:
# FOR THE INCOMMING REFFERENCES
# (FILE PATHS, GEOMETRIES ...                     )

# group: SORT
# note: SORT
# note: USE:
# (SORTING THROUGH, FILTERING OR PROCCESSING DATA OR INFOMATION)

# group: Outputs
# note: OUTPUT
# note: USE:
# (DATA GOING BACK TO OUT CIVIL 3D, EXCEL OR OTHER)

# group: NEEDS REFINEMENT
# note: NEEDS REFINEMENT
# note: USE:
# (NEEDS REFINEMENT; THE LAST THING YOUR WERE WORKING ON OR PERHAPS UNRESOLVED ISSUES, COULD ALSO MEAN I THINK THE ISSUE IS IN THIS GROUP OF NODES)

# group: Review
# note: REVIEW
# note: USE:
# FOR IMPORTANT WATCH NODES

# group: CONTROL
# note: CONTROL
# note: USE:
# FOR THE USER INPUT (SUCH AS SLIDERS,
#  NUMBERS, ....)

# group: DESIGN
# note: DESIGN
# note: USE:
# FOR THE BACK-END FUNCTIONALITY

# group: WIP
# note: WIP
# note: USE:
# FOR "WORK IN PROGRESS"

# group: FOR INFORMATION ONLY - REMOVE
# note: Jacobs Dynamo File Naming Convention:
# [MK]_[DIS]_[FAM/PRJ]_(*Project Name)_(Author)_[Title]_[Date]_[Version].dyn
# [MK] = 2 character group name for your market or ZZ for a market agnostic definition. (CP - Cities & Places; AF - Advanced Facilities; HE - Health; TR - Transportation; WA - Water; EP- Energy & Power; EN - Environmental)
# [DIS] = 3 character group name for your discipline or GEN for a generic definition.
# [FAM/PRJ] = Is the definition to be executed on a family or project?
# (*Project Name) = Optional to include the project name if definition was created for a specific project.
# (*Author's Initials) = Take credit for this great graph.
# [Title] = WhatTheScriptDoes
# [Version] = Version to match vX.X
# Examples:
# ZZ_GEN_PRJ_AddNewLevelAboveExistingByCurrentOffset_v1.0
# CP_ARC_PRJ_L100XXXX_SheetReferenceTool_v1.2

# group: TO REVIT / C3D
# note: TO CIVIL
# note: USE:
# FOR BLOCKS THAT EXPORT THE GEOMETRY AND PARAMETERS TO REVIT

# group: MONITOR
# note: MONITOR
# note: USE:
# FOR IMPORTANT WATCH NODES

# group: ANNOTATION
# note: ANNOTATION
# note: USE:
# FOR COMMENTS

sheet_name = StringInput("Typical Section - Riffle")

# group: Assembly Name, Subassembly names, location
code_block = CodeBlock { "LinkWidthAndSlope"; "Subassembly.LinkWidthAndSlope"; }
code_block_2 = CodeBlock()
# ---------- code_block_2.designscript (10 lines) ----------
"Right Channel Bed";
"Right Slope";
"Right Bench";
"Right Upper Slope";
 //Right
"Left Channel Bed";
"Left Slope";
"Left Bench";
"Left Upper Slope";
 //Left
# ----------------------------------------
pick_point = PickPoint()  # 1 picked in the model
integer_slider = IntegerSlider(5, range=0..6 step 1)
byNamePoint = Autodesk.Civil.DynamoNodes.CorridorExtensions.Assembly.ByNamePoint(name=sheet_name, location=pick_point, assemblyType=integer_slider)

# group: RIGHT SIDE > Right Side Subassemblies
importStockSubassembly = Autodesk.Civil.DynamoNodes.CorridorExtensions.Subassembly.ImportStockSubassembly(toolName=code_block.out0, className=code_block.out1, name=code_block_2.out0)
importStockSubassembly_2 = Autodesk.Civil.DynamoNodes.CorridorExtensions.Subassembly.ImportStockSubassembly(toolName=code_block.out0, className=code_block.out1, name=code_block_2.out1)
importStockSubassembly_3 = Autodesk.Civil.DynamoNodes.CorridorExtensions.Subassembly.ImportStockSubassembly(toolName=code_block.out0, className=code_block.out1, name=code_block_2.out2)
importStockSubassembly_4 = Autodesk.Civil.DynamoNodes.CorridorExtensions.Subassembly.ImportStockSubassembly(toolName=code_block.out0, className=code_block.out1, name=code_block_2.out3)
name = Autodesk.Civil.DynamoNodes.CivilObject.Name(civilObject=importStockSubassembly)
code_block_3 = CodeBlock { "Right"; 1; }
addSubassembly = Autodesk.Civil.DynamoNodes.CorridorExtensions.Assembly.AddSubassembly(assembly=byNamePoint, subassemblyName=name, groupName=code_block_3.out0, side=code_block_3.out1)
name_2 = Autodesk.Civil.DynamoNodes.CivilObject.Name(civilObject=importStockSubassembly_2)
code_block_4 = CodeBlock(g=addSubassembly.Group, s=addSubassembly.Subassembly) { g.Name; s.Name; 1; 1; }
addSubassembly_2 = Autodesk.Civil.DynamoNodes.CorridorExtensions.Assembly.AddSubassembly(assembly=addSubassembly.Assembly, subassemblyName=name_2, groupName=code_block_4.out0, hookSubassembly=code_block_4.out1, hookPoint=code_block_4.out2, side=code_block_4.out3)
name_3 = Autodesk.Civil.DynamoNodes.CivilObject.Name(civilObject=importStockSubassembly_3)
code_block_5 = CodeBlock(g=addSubassembly_2.Group, s=addSubassembly_2.Subassembly) { g.Name; s.Name; 1; 1; }
addSubassembly_3 = Autodesk.Civil.DynamoNodes.CorridorExtensions.Assembly.AddSubassembly(assembly=addSubassembly_2.Assembly, subassemblyName=name_3, groupName=code_block_5.out0, hookSubassembly=code_block_5.out1, hookPoint=code_block_5.out2, side=code_block_5.out3)
name_4 = Autodesk.Civil.DynamoNodes.CivilObject.Name(civilObject=importStockSubassembly_4)
code_block_6 = CodeBlock(g=addSubassembly_3.Group, s=addSubassembly_3.Subassembly) { g.Name; s.Name; 1; 1; }
addSubassembly_4 = Autodesk.Civil.DynamoNodes.CorridorExtensions.Assembly.AddSubassembly(assembly=addSubassembly_3.Assembly, subassemblyName=name_4, groupName=code_block_6.out0, hookSubassembly=code_block_6.out1, hookPoint=code_block_6.out2, side=code_block_6.out3)

boolean = BoolSelector(true)

# group: Extracting Data from XLS
file_path = Filename(".\KK River Revised 30% Channel Design Calcs.xlsx")
file_from_path = FileObject(path=file_path)
importExcel = Data.ImportExcel(file=file_from_path, sheetName=sheet_name, showExcel=boolean)
transpose = List.Transpose(lists=importExcel)
clean = List.Clean(list=transpose)
code_block_7 = CodeBlock { 0; 2; }
slice = List.Slice(list=clean, start=code_block_7.out0, end=code_block_7.out1)
transpose_2 = List.Transpose(lists=slice)
code_block_8 = CodeBlock { 4; 13; }
slice_2 = List.Slice(list=transpose_2, start=code_block_8.out0, end=code_block_8.out1)
transpose_3 = List.Transpose(lists=slice_2)

# group: Remove CL Values
code_block_9 = CodeBlock { 4; }
removeItemAtIndex = List.RemoveItemAtIndex(list=transpose_3@L2, indices=code_block_9)

# group: Elev Relative to 0
code_block_10 = CodeBlock { 1; 2; }
slice_3 = List.Slice(list=removeItemAtIndex, start=code_block_10.out0, end=code_block_10.out1)

# group: Elevation - Right Side [Stepping]
code_block_11 = CodeBlock { 4; 8; }
slice_4 = List.Slice(list=slice_3@L2, start=code_block_11.out0, end=code_block_11.out1)
restOfItems = List.RestOfItems(list=slice_4@L2)
sub = restOfItems - slice_4
code_block_12 = CodeBlock { 4; 5; }
slice_5 = List.Slice(list=slice_3@L2, start=code_block_12.out0, end=code_block_12.out1)
code_block_13 = CodeBlock { 0; }
insert = List.Insert(list=sub, element=slice_5, index=code_block_13)
flatten = List.Flatten(list=insert)

# group: Offset Distances
code_block_14 = CodeBlock { 0; 1; }
slice_6 = List.Slice(list=removeItemAtIndex, start=code_block_14.out0, end=code_block_14.out1)

# group: Offset - Right Side [Stepping]
code_block_15 = CodeBlock { 4; 8; }
slice_7 = List.Slice(list=slice_6@L2, start=code_block_15.out0, end=code_block_15.out1)
restOfItems_2 = List.RestOfItems(list=slice_7@L2)
sub_2 = restOfItems_2 - slice_7
code_block_16 = CodeBlock { 4; 5; }
slice_8 = List.Slice(list=slice_6@L2, start=code_block_16.out0, end=code_block_16.out1)
code_block_17 = CodeBlock { 0; }
insert_2 = List.Insert(list=sub_2, element=slice_8, index=code_block_17)
flatten_2 = List.Flatten(list=insert_2)

# group: Offset - Right Side [Stepping] > Offsets
code_block_18 = CodeBlock { 0; 1; }
slice_9 = List.Slice(list=flatten_2, start=code_block_18.out0, end=code_block_18.out1)
code_block_19 = CodeBlock { 1; 2; }
slice_10 = List.Slice(list=flatten_2, start=code_block_19.out0, end=code_block_19.out1)
code_block_20 = CodeBlock { 2; 3; }
slice_11 = List.Slice(list=flatten_2, start=code_block_20.out0, end=code_block_20.out1)
code_block_21 = CodeBlock { 3; 4; }
slice_12 = List.Slice(list=flatten_2, start=code_block_21.out0, end=code_block_21.out1)

# group: LEFT SIDE > Right Side Subassemblies
importStockSubassembly_5 = Autodesk.Civil.DynamoNodes.CorridorExtensions.Subassembly.ImportStockSubassembly(toolName=code_block.out0, className=code_block.out1, name=code_block_2.out4)
importStockSubassembly_6 = Autodesk.Civil.DynamoNodes.CorridorExtensions.Subassembly.ImportStockSubassembly(toolName=code_block.out0, className=code_block.out1, name=code_block_2.out5)
importStockSubassembly_7 = Autodesk.Civil.DynamoNodes.CorridorExtensions.Subassembly.ImportStockSubassembly(toolName=code_block.out0, className=code_block.out1, name=code_block_2.out6)
importStockSubassembly_8 = Autodesk.Civil.DynamoNodes.CorridorExtensions.Subassembly.ImportStockSubassembly(toolName=code_block.out0, className=code_block.out1, name=code_block_2.out7)
name_5 = Autodesk.Civil.DynamoNodes.CivilObject.Name(civilObject=importStockSubassembly_5)
code_block_22 = CodeBlock { "Left"; 0; }
addSubassembly_5 = Autodesk.Civil.DynamoNodes.CorridorExtensions.Assembly.AddSubassembly(assembly=byNamePoint, subassemblyName=name_5, groupName=code_block_22.out0)
name_6 = Autodesk.Civil.DynamoNodes.CivilObject.Name(civilObject=importStockSubassembly_6)
code_block_23 = CodeBlock(g=addSubassembly_5.Group, s=addSubassembly_5.Subassembly) { g.Name; s.Name; 1; 0; }
addSubassembly_6 = Autodesk.Civil.DynamoNodes.CorridorExtensions.Assembly.AddSubassembly(assembly=addSubassembly_5.Assembly, subassemblyName=name_6, groupName=code_block_23.out0, hookSubassembly=code_block_23.out1, hookPoint=code_block_23.out2, side=code_block_23.out3)
name_7 = Autodesk.Civil.DynamoNodes.CivilObject.Name(civilObject=importStockSubassembly_7)
code_block_24 = CodeBlock(g=addSubassembly_6.Group, s=addSubassembly_6.Subassembly) { g.Name; s.Name; 1; 0; }
addSubassembly_7 = Autodesk.Civil.DynamoNodes.CorridorExtensions.Assembly.AddSubassembly(assembly=addSubassembly_6.Assembly, subassemblyName=name_7, groupName=code_block_24.out0, hookSubassembly=code_block_24.out1, hookPoint=code_block_24.out2, side=code_block_24.out3)
name_8 = Autodesk.Civil.DynamoNodes.CivilObject.Name(civilObject=importStockSubassembly_8)
code_block_25 = CodeBlock(g=addSubassembly_7.Group, s=addSubassembly_7.Subassembly) { g.Name; s.Name; 1; 0; }
addSubassembly_8 = Autodesk.Civil.DynamoNodes.CorridorExtensions.Assembly.AddSubassembly(assembly=addSubassembly_7.Assembly, subassemblyName=name_8, groupName=code_block_25.out0, hookSubassembly=code_block_25.out1, hookPoint=code_block_25.out2, side=code_block_25.out3)

# group: Elevation - Left Side [Stepping]
code_block_26 = CodeBlock { 0; 4; }
slice_13 = List.Slice(list=slice_3@L2, start=code_block_26.out0, end=code_block_26.out1)
reverse = List.Reverse(list=slice_13@L2)
restOfItems_3 = List.RestOfItems(list=reverse@L2)
sub_3 = restOfItems_3 - reverse
code_block_27 = CodeBlock { 3; 4; }
slice_14 = List.Slice(list=slice_3@L2, start=code_block_27.out0, end=code_block_27.out1)
code_block_28 = CodeBlock { 0; }
insert_3 = List.Insert(list=sub_3, element=slice_14, index=code_block_28)
flatten_3 = List.Flatten(list=insert_3)

# group: Offset - Left Side [Stepping]
code_block_29 = CodeBlock { 0; 4; }
slice_15 = List.Slice(list=slice_6@L2, start=code_block_29.out0, end=code_block_29.out1)
reverse_2 = List.Reverse(list=slice_15@L2)
restOfItems_4 = List.RestOfItems(list=reverse_2@L2)
sub_4 = restOfItems_4 - reverse_2
code_block_30 = CodeBlock { 3; 4; }
slice_16 = List.Slice(list=slice_6@L2, start=code_block_30.out0, end=code_block_30.out1)
code_block_31 = CodeBlock { 0; }
insert_4 = List.Insert(list=sub_4, element=slice_16, index=code_block_31)
flatten_4 = List.Flatten(list=insert_4)

# group: Offset - Left Side [Stepping] > Absolute Value
abs = Math.Abs(number=flatten_4)

# group: Calc the slope %'s
div = flatten / flatten_2
div_2 = flatten_3 / abs

# group: Offsets
code_block_32 = CodeBlock { 0; 1; }
slice_17 = List.Slice(list=div, start=code_block_32.out0, end=code_block_32.out1)
code_block_33 = CodeBlock { 1; 2; }
slice_18 = List.Slice(list=div, start=code_block_33.out0, end=code_block_33.out1)
code_block_34 = CodeBlock { 2; 3; }
slice_19 = List.Slice(list=div, start=code_block_34.out0, end=code_block_34.out1)
code_block_35 = CodeBlock { 3; 4; }
slice_20 = List.Slice(list=div, start=code_block_35.out0, end=code_block_35.out1)

# group: RIGHT SIDE > Channel Bed Settings
code_block_36 = CodeBlock { "4115"; "4109"; "4105"; }
list_create = List.Create(item0=code_block_36.out0, item1=code_block_36.out1, item2=code_block_36.out2)
code_block_37 = CodeBlock()
# ---------- code_block_37.designscript (6 lines) ----------
"0.00";
 //SLOPE
"13.1";
 //WIDTH
"0";
 //Side? 0=Right 1=Left
# ----------------------------------------
list_create_2 = List.Create(item0=slice_17, item1=slice_9, item2=code_block_37.out2)
boolean_2 = BoolSelector(true)
setParameterValueByName = Autodesk.Civil.DynamoNodes.CorridorExtensions.Subassembly.SetParameterValueByName(subassembly=importStockSubassembly, parameter=list_create, value=list_create_2, rebuild=boolean_2)

# group: RIGHT SIDE > Channel Slope Settings
code_block_38 = CodeBlock { "4115"; "4109"; "4105"; }
list_create_3 = List.Create(item0=code_block_38.out0, item1=code_block_38.out1, item2=code_block_38.out2)
code_block_39 = CodeBlock()
# ---------- code_block_39.designscript (6 lines) ----------
"0.3333";
 //SLOPE
"5";
 //WIDTH
"0";
 //Side? 0=Right 1=Left
# ----------------------------------------
list_create_4 = List.Create(item0=slice_18, item1=slice_10, item2=code_block_39.out2)
boolean_3 = BoolSelector(true)
setParameterValueByName_2 = Autodesk.Civil.DynamoNodes.CorridorExtensions.Subassembly.SetParameterValueByName(subassembly=importStockSubassembly_2, parameter=list_create_3, value=list_create_4, rebuild=boolean_3)

# group: RIGHT SIDE > Bench Settings
code_block_40 = CodeBlock { "4115"; "4109"; "4105"; }
list_create_5 = List.Create(item0=code_block_40.out0, item1=code_block_40.out1, item2=code_block_40.out2)
code_block_41 = CodeBlock()
# ---------- code_block_41.designscript (6 lines) ----------
"0.025";
 //SLOPE
"20";
 //WIDTH
"0";
 //Side? 0=Right 1=Left
# ----------------------------------------
list_create_6 = List.Create(item0=slice_19, item1=slice_11, item2=code_block_41.out2)
boolean_4 = BoolSelector(true)
setParameterValueByName_3 = Autodesk.Civil.DynamoNodes.CorridorExtensions.Subassembly.SetParameterValueByName(subassembly=importStockSubassembly_3, parameter=list_create_5, value=list_create_6, rebuild=boolean_4)

# group: RIGHT SIDE > Upper Slope Settings
code_block_42 = CodeBlock { "4115"; "4109"; "4105"; }
list_create_7 = List.Create(item0=code_block_42.out0, item1=code_block_42.out1, item2=code_block_42.out2)
code_block_43 = CodeBlock()  # same code as code_block_41
list_create_8 = List.Create(item0=slice_20, item1=slice_12, item2=code_block_43.out2)
boolean_5 = BoolSelector(true)
setParameterValueByName_4 = Autodesk.Civil.DynamoNodes.CorridorExtensions.Subassembly.SetParameterValueByName(subassembly=importStockSubassembly_4, parameter=list_create_7, value=list_create_8, rebuild=boolean_5)

# group: Offsets
code_block_44 = CodeBlock { 0; 1; }
slice_21 = List.Slice(list=div_2, start=code_block_44.out0, end=code_block_44.out1)
code_block_45 = CodeBlock { 1; 2; }
slice_22 = List.Slice(list=div_2, start=code_block_45.out0, end=code_block_45.out1)
code_block_46 = CodeBlock { 2; 3; }
slice_23 = List.Slice(list=div_2, start=code_block_46.out0, end=code_block_46.out1)
code_block_47 = CodeBlock { 3; 4; }
slice_24 = List.Slice(list=div_2, start=code_block_47.out0, end=code_block_47.out1)

# group: Offset - Left Side [Stepping] > Offsets
code_block_48 = CodeBlock { 0; 1; }
slice_25 = List.Slice(list=abs, start=code_block_48.out0, end=code_block_48.out1)
code_block_49 = CodeBlock { 1; 2; }
slice_26 = List.Slice(list=abs, start=code_block_49.out0, end=code_block_49.out1)
code_block_50 = CodeBlock { 2; 3; }
slice_27 = List.Slice(list=abs, start=code_block_50.out0, end=code_block_50.out1)
code_block_51 = CodeBlock { 3; 4; }
slice_28 = List.Slice(list=abs, start=code_block_51.out0, end=code_block_51.out1)

# group: LEFT SIDE > Channel Bed Settings
code_block_52 = CodeBlock { "4115"; "4109"; "4105"; }
list_create_9 = List.Create(item0=code_block_52.out0, item1=code_block_52.out1, item2=code_block_52.out2)
code_block_53 = CodeBlock()
# ---------- code_block_53.designscript (6 lines) ----------
"0.00";
 //SLOPE
"13.1";
 //WIDTH
"1";
 //Side? 0=Right 1=Left
# ----------------------------------------
list_create_10 = List.Create(item0=slice_21, item1=slice_25, item2=code_block_53.out2)
boolean_6 = BoolSelector(true)
setParameterValueByName_5 = Autodesk.Civil.DynamoNodes.CorridorExtensions.Subassembly.SetParameterValueByName(subassembly=importStockSubassembly_5, parameter=list_create_9, value=list_create_10, rebuild=boolean_6)

# group: LEFT SIDE > Channel Slope Settings
code_block_54 = CodeBlock { "4115"; "4109"; "4105"; }
list_create_11 = List.Create(item0=code_block_54.out0, item1=code_block_54.out1, item2=code_block_54.out2)
code_block_55 = CodeBlock()
# ---------- code_block_55.designscript (6 lines) ----------
"0.3333";
 //SLOPE
"5";
 //WIDTH
"1";
 //Side? 0=Right 1=Left
# ----------------------------------------
list_create_12 = List.Create(item0=slice_22, item1=slice_26, item2=code_block_55.out2)
boolean_7 = BoolSelector(true)
setParameterValueByName_6 = Autodesk.Civil.DynamoNodes.CorridorExtensions.Subassembly.SetParameterValueByName(subassembly=importStockSubassembly_6, parameter=list_create_11, value=list_create_12, rebuild=boolean_7)

# group: LEFT SIDE > Bench Settings
code_block_56 = CodeBlock { "4115"; "4109"; "4105"; }
list_create_13 = List.Create(item0=code_block_56.out0, item1=code_block_56.out1, item2=code_block_56.out2)
code_block_57 = CodeBlock()
# ---------- code_block_57.designscript (6 lines) ----------
"0.025";
 //SLOPE
"20";
 //WIDTH
"1";
 //Side? 0=Right 1=Left
# ----------------------------------------
list_create_14 = List.Create(item0=slice_23, item1=slice_27, item2=code_block_57.out2)
boolean_8 = BoolSelector(true)
setParameterValueByName_7 = Autodesk.Civil.DynamoNodes.CorridorExtensions.Subassembly.SetParameterValueByName(subassembly=importStockSubassembly_7, parameter=list_create_13, value=list_create_14, rebuild=boolean_8)

# group: LEFT SIDE > Upper Slope Settings
code_block_58 = CodeBlock { "4115"; "4109"; "4105"; }
list_create_15 = List.Create(item0=code_block_58.out0, item1=code_block_58.out1, item2=code_block_58.out2)
code_block_59 = CodeBlock()  # same code as code_block_57
list_create_16 = List.Create(item0=slice_24, item1=slice_28, item2=code_block_59.out2)
boolean_9 = BoolSelector(true)
setParameterValueByName_8 = Autodesk.Civil.DynamoNodes.CorridorExtensions.Subassembly.SetParameterValueByName(subassembly=importStockSubassembly_8, parameter=list_create_15, value=list_create_16, rebuild=boolean_9)

current = Autodesk.AutoCAD.DynamoNodes.Document.Current()
code_block_60 = CodeBlock { "zoom extents "; }

# group: Gate
gated_passthrough_node = CodeBlock(passthrough1=code_block_60, waitfor1=addSubassembly_8.Assembly, waitfor2=addSubassembly_4.Assembly) { [passthrough1,waitfor1,waitfor2][0]; }

sendCommand = Camber.AutoCAD.Document.SendCommand(document=current, command=gated_passthrough_node)
