# Dynamo graph CP_CIV_FAM_TBW_Update_Profile_from_XLSX_2024-07-02_0.8.dyn (Dynamo 2.19.4.6671)
# packages: Arkance Systems 7.3.0

# note: DYNAMO DEFAULTS
# note: ADDITIONAL PERSONAL CATEGORIES
# note: |
# |
# |
# |
# |
# |
# |
# |
# |
# |
# |
# |
# |
# |
# |
# |
# |
# |
# |
# |
# |
# |
# |
# |
# |
# |
# |
# note: ADDITIONAL JACOBS CATEGORIES
# note: CP_CIV_FAM_TBW_Update_Profile_from_XLSX_2024-07-02_0.8.dyn

# group: <PROJECT NO.> <PROJECT NAME>
# note: Created By: FirstName LastName
# Email:  your.email@jacobs.com
# Phone: XXX-XXX-XXXX (optional)
# VERSION HISTORY
# YYYY-MM-DD v0.x: Pre-Release Builds
# YYYY-MM-DD v1.0: Initial Release Build
# YYYY-MM-DD v1.x: Minor Release Build (bug fix, revisions to groups, documentation, etc..)
# YYYY-MM-DD v2.0: Major Release Build (re-design due to depreciated nodes, addition of new features, identification of more optimized node layouts)
# DYNAMO VERSION: <Dynamo 2.6.0>
# PACKAGES:
# <PACKAGES>
# NOTES:
# <NOTES>
# JACOBS DYNAMO GRAPHIC STANDARD - 2022
# ADAPTED BY: MARINA VILLANUEVA
# SOURCES: Vladimir Ondejcik, WHITE ARKITEKTER AB - 2016 & JACOBS US GRAPHIC STANDARD - 2017

# group: DESIGNER'S GUIDELINES
# note: DESIGNER'S GUIDELINES
# 1. DIVIDE THE DYNAMO DEFINITION INTO THE USER INTERFACE AND THE BACK-END
# 2. BUILD THE DEFINITION WITH SMALL BLOCKS
# 3. BLOCKS SHOULD ALWAYS HAVE INPUT/OUTPUT
# 4. RENAME INPUT/OUTPUT CONTAINERS TO DATA THEY CARRY
# 5. COLOR-CODE BLOCKS ACCORDING TO THE TEMPLATE

# group: Input
# note: INPUT
# note: USE:
# FOR THE INCOMMING REFFERENCES
# (FILE PATHS, GEOMETRIES ...                     )

# group: Actions
# note: INPUT
# note: USE:
# (NODES THAT PROCESS OR REFINE DATA, MATH OR OTHER INPUTS)

# group: SORT
# note: SORT
# note: USE:
# (SORTING THROUGH, FILTERING OR PROCCESSING DATA OR INFOMATION)

# group: FOR INFORMATION ONLY - REMOVE
# note: Jacobs Dynamo File Naming Convention:
# [MK]_[DIS]_[FAM/PRJ]_(*Project Name)_(Author)_[Title]_[Date]_[Version].dyn
# [MK] = 2 character group name for your market or ZZ for a market agnostic definition. (CP - Cities & Places; AF - Advanced Facilities; HE - Health; TR - Transportation; WA - Water; EP- Energy & Power; EN - Environmental)
# [DIS] = 3 character group name for your discipline or GEN for a generic definition.
# [FAM/PRJ] = Is the definition to be executed on a family or project?
# (*Project Name) = Optional to include the project name if definition was created for a specific project.
# (*Author's Initials) = Take credit for this great graph.
# [Title] = WhatTheScriptDoes
# [Version] = Version to match vX.X
# Examples:
# ZZ_GEN_PRJ_AddNewLevelAboveExistingByCurrentOffset_v1.0
# CP_ARC_PRJ_L100XXXX_SheetReferenceTool_v1.2

# group: Outputs
# note: OUTPUT
# note: USE:
# (DATA GOING BACK TO OUT CIVIL 3D, EXCEL OR OTHER)

# group: Review
# note: REVIEW
# note: USE:
# FOR IMPORTANT WATCH NODES

# group: NEEDS REFINEMENT
# note: NEEDS REFINEMENT
# note: USE:
# (NEEDS REFINEMENT; THE LAST THING YOUR WERE WORKING ON OR PERHAPS UNRESOLVED ISSUES, COULD ALSO MEAN I THINK THE ISSUE IS IN THIS GROUP OF NODES)

# group: CONTROL
# note: CONTROL
# note: USE:
# FOR THE USER INPUT (SUCH AS SLIDERS,
#  NUMBERS, ....)

# group: DESIGN
# note: DESIGN
# note: USE:
# FOR THE BACK-END FUNCTIONALITY

# group: WIP
# note: WIP
# note: USE:
# FOR "WORK IN PROGRESS"

# group: TO REVIT / C3D
# note: TO CIVIL
# note: USE:
# FOR BLOCKS THAT EXPORT THE GEOMETRY AND PARAMETERS TO REVIT

# group: MONITOR
# note: MONITOR
# note: USE:
# FOR IMPORTANT WATCH NODES

# group: ANNOTATION
# note: ANNOTATION
# note: USE:
# FOR COMMENTS

# group: Inputs
alignment_dropdown = AlignmentDropDown("Proposed Stream CL")
profile_name_string = StringInput("Revised Stream Profile")
file_path = Filename(".\KK River Revised 30% Channel Design Calcs.xlsx")
file_from_path = FileObject(path=file_path)
sheet_name = StringInput("Stream Profile")
bench_profile_name_string = StringInput("Revised Bankfull Bench")

XLS_Channel_Data = Custom[XLS_Channel_Data](file=file_from_path, sheetName=sheet_name)  # Extracting and Sorting Station and Elevation Data from Excel

# group: Create Thalweg Profile
stationElevation = Civil3D.Geometry.StationElevation.StationElevation(station=XLS_Channel_Data.Station, elevation=XLS_Channel_Data.Thalweg_Elev)
createLayoutProfile = Civil3D.Geometry.Profile.CreateLayoutProfile(alignment=alignment_dropdown, profilename=profile_name_string, vertices=stationElevation)

# group: Create Bankfull Bench Profile
stationElevation_2 = Civil3D.Geometry.StationElevation.StationElevation(station=XLS_Channel_Data.Station, elevation=XLS_Channel_Data.Bench_Elev)
createLayoutProfile_2 = Civil3D.Geometry.Profile.CreateLayoutProfile(alignment=alignment_dropdown, profilename=bench_profile_name_string, vertices=stationElevation_2)
