# Dynamo custom node Create_Alignment_Profile.dyf "Create_Profile" (Dynamo 2.19.4.6671)
# category: TBW.create.profile
# Create Profile
# packages: Arkance Systems 7.3.0

alignment = Input(alignment: Autodesk.Civil.DynamoNodes.Alignment)
profilename = Input(profilename: string)
station = Input(station: double)
elevation = Input(elevation: double)
stationElevation = Civil3D.Geometry.StationElevation.StationElevation(station=station, elevation=elevation)
createLayoutProfile = Civil3D.Geometry.Profile.CreateLayoutProfile(alignment=alignment, profilename=profilename, vertices=stationElevation)
Profile = Output(createLayoutProfile)
