# Dynamo custom node TBW_XLSX_Region_Data.dyf (Dynamo 2.19.4.6671)
# category: TBW.import.regions.xlsx
# Imports the region data from a given Excel File. Nodes can be updated to point to specific cells for this content.

file = Input(file: var[]..[])
sheetName = Input(sheetName: string)

# group: Extracting and sorting Section and Region data from XLSX
boolean = BoolSelector(false)
importExcel = Data.ImportExcel(file=file, sheetName=sheetName, showExcel=boolean)
code_block = CodeBlock { 1; }
dropItems = List.DropItems(list=importExcel, amount=code_block)
code_block_2 = CodeBlock { -53; }
dropItems_2 = List.DropItems(list=dropItems, amount=code_block_2)
transpose = List.Transpose(lists=dropItems_2)
code_block_3 = CodeBlock { 0; 1; }
region_names_list_slice = List.Slice(list=transpose, start=code_block_3.out0, end=code_block_3.out1)
code_block_4 = CodeBlock { 1; 2; }
typical_sections_list_slice = List.Slice(list=transpose, start=code_block_4.out0, end=code_block_4.out1)
boolean_2 = BoolSelector(false)
typical_sections_list_clean = List.Clean(list=typical_sections_list_slice, preserveIndices=boolean_2)

RegionsNames = Output(region_names_list_slice)
assmeblyName = Output(typical_sections_list_clean)
