# Dynamo custom node XLS_Channel_Data.dyf (Dynamo 2.19.4.6671)
# category: TBW.import.Channel_Data.xlsx
# Extracting and Sorting Station and Elevation Data from Excel

file = Input(file: var[]..[])
sheetName = Input(sheetName: string)

# group: Extracting and sorting Station and Elevation Content from XLSX
boolean = BoolSelector(true)
importExcel = Data.ImportExcel(file=file, sheetName=sheetName, showExcel=boolean)
code_block = CodeBlock { 1; }
dropItems = List.DropItems(list=importExcel, amount=code_block)
code_block_2 = CodeBlock { -53; }
dropItems_2 = List.DropItems(list=dropItems, amount=code_block_2)
transpose = List.Transpose(lists=dropItems_2)
code_block_3 = CodeBlock { 5; 7; }
dropItems_3 = List.DropItems(list=transpose, amount=code_block_3.out1)
code_block_4 = CodeBlock { 0; 1; }
thalweg_elevations_list_slice = List.Slice(list=dropItems_3, start=code_block_4.out0, end=code_block_4.out1)
dropItems_4 = List.DropItems(list=transpose, amount=code_block_3.out0)
code_block_5 = CodeBlock { 0; 1; }
station_list_slice = List.Slice(list=dropItems_4, start=code_block_5.out0, end=code_block_5.out1)
code_block_6 = CodeBlock { 10; 11; }
bench_elevations_list_slice = List.Slice(list=transpose, start=code_block_6.out0, end=code_block_6.out1)

Thalweg_Elev = Output(thalweg_elevations_list_slice)
Station = Output(station_list_slice)
Bench_Elev = Output(bench_elevations_list_slice)

# group: Filter Out first station value
code_block_7 = CodeBlock { 1; }
dropItems_5 = List.DropItems(list=station_list_slice@L2, amount=code_block_7)

StationLessFirstValue = Output(dropItems_5)
